# Grasshopper definition PFHG_002.gh (Grasshopper 1.0.7)
# plug-ins: Hops

# ----
# PFHG_002.py
# Examples on McNeel
curve = Curve(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)
number_slider = Slider(0.31, range=0..1)
curve_end_points = Hops(
    Curve=reparameterize(curve),
    CacheResultsInMemory=False,
    CacheSolveResults=False,
    RemoteDefinitionLocation="http://127.0.0.1:5000/curve_end_points",
    RemoteSolveVersion=(0, 1, 0),
    ShowInput_Enabled=False,
    ShowInput_Path=False,
    SynchronousSolve=True)  # -> S, E
unit_z = UnitZ(Factor=Slider(27, range=0..100))
point = Point([curve_end_points.S, curve_end_points.E])
move = Move(Geometry=point, Motion=unit_z)  # -> Geometry, Transform
dispatch = Dispatch(List=flatten(move.Geometry), DispatchPattern=[True, False])  # -> ListA, ListB
line = Line(StartPoint=dispatch.ListB, EndPoint=dispatch.ListA)
pointat = Hops(
    Curve=reparameterize(line),
    T=number_slider,
    CacheResultsInMemory=True,
    CacheSolveResults=True,
    RemoteDefinitionLocation="http://127.0.0.1:5000/pointat",
    RemoteSolveVersion=(0, 1, 0),
    ShowInput_Enabled=False,
    ShowInput_Path=False,
    SynchronousSolve=True)
pointat_2 = Hops(
    Curve=reparameterize(curve),
    T=number_slider,
    CacheResultsInMemory=False,
    CacheSolveResults=False,
    RemoteDefinitionLocation="http://127.0.0.1:5000/pointat",
    RemoteSolveVersion=(0, 1, 0),
    ShowInput_Enabled=False,
    ShowInput_Path=False,
    SynchronousSolve=True)
curve_end_points_2 = Hops(
    Curve=reparameterize(line),
    CacheResultsInMemory=False,
    CacheSolveResults=False,
    RemoteDefinitionLocation="http://127.0.0.1:5000/curve_end_points",
    RemoteSolveVersion=(0, 1, 0),
    ShowInput_Enabled=False,
    ShowInput_Path=False,
    SynchronousSolve=True)  # -> S, E
srf4pt = Hops(
    CornerA=curve_end_points.S,
    CornerB=pointat_2,
    CornerC=curve_end_points_2.S,
    CornerD=pointat,
    CacheResultsInMemory=False,
    CacheSolveResults=False,
    RemoteDefinitionLocation="http://127.0.0.1:5000/srf4pt",
    RemoteSolveVersion=(0, 1, 0),
    ShowInput_Enabled=False,
    ShowInput_Path=False,
    SynchronousSolve=True)

# ----
# Examples Wickerson Studios
boolean_toggle = BooleanToggle(False)
panel = Panel("[]")
number_slider_2 = Slider(54, range=0..100)
booleans = Hops(
    BoolA=boolean_toggle,
    BoolB=Toggle(False),
    CacheResultsInMemory=False,
    CacheSolveResults=False,
    RemoteDefinitionLocation="http://127.0.0.1:5000/booleans",
    RemoteSolveVersion=(0, 1, 0),
    ShowInput_Enabled=False,
    ShowInput_Path=False,
    SynchronousSolve=True)
advanced_booleans = Hops(
    Num1=Slider(12, range=0..100),
    Num2=Slider(22, range=0..100),
    CacheResultsInMemory=True,
    CacheSolveResults=True,
    RemoteDefinitionLocation="http://127.0.0.1:5000/advanced_booleans",
    RemoteSolveVersion=(0, 1, 0),
    ShowInput_Enabled=False,
    ShowInput_Path=False,
    SynchronousSolve=True)  # -> Less, Greater
advanced_calculator = Hops(
    A=Slider(2.886, range=0..10),
    B=Slider(1.388, range=0..10),
    CacheResultsInMemory=False,
    CacheSolveResults=False,
    RemoteDefinitionLocation="http://127.0.0.1:5000/advanced_calculator",
    RemoteSolveVersion=(0, 1, 0),
    ShowInput_Enabled=False,
    ShowInput_Path=False,
    SynchronousSolve=True)  # -> DivideDown, Modulus, Negative, CastInt, CastFloat, Exponent
deadcode = Hops(
    CacheResultsInMemory=False,
    CacheSolveResults=False,
    RemoteDefinitionLocation="http://127.0.0.1:5000/deadCode",
    RemoteSolveVersion=(0, 1, 0),
    ShowInput_Enabled=False,
    ShowInput_Path=False,
    SynchronousSolve=True)  # -> Out, AOut
panel_2 = Panel(booleans)
panel_3 = Panel([advanced_booleans.Less, advanced_booleans.Greater])
panel_4 = Panel(deadcode.Out)
panel_5 = Panel(deadcode.AOut)
panel_6 = Panel([advanced_calculator.DivideDown, advanced_calculator.Modulus, advanced_calculator.Negative, advanced_calculator.CastInt, advanced_calculator.CastFloat, advanced_calculator.Exponent])
