# Grasshopper definition PFHG_003.gh (Grasshopper 1.0.7)
# plug-ins: Hops

# ----
# Examples Wickerson Studios
# Examples on McNeel
number_slider = Slider(10, range=0..10)
curve = Curve(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)
number_slider_2 = Slider(0.52, range=0..1)
# PFHG_003.py
curve_end_points = Hops(
    Curve=reparameterize(curve),
    CacheResultsInMemory=False,
    CacheSolveResults=False,
    RemoteDefinitionLocation="http://127.0.0.1:5000/curve_end_points",
    RemoteSolveVersion=(0, 1, 0),
    ShowInput_Enabled=False,
    ShowInput_Path=False,
    SynchronousSolve=True)  # -> S, E
range = Range(Domain=Domain(0, 1), Steps=number_slider)
unit_z = UnitZ(Factor=Slider(27, range=0..100))
point = Point([curve_end_points.S, curve_end_points.E])
move = Move(Geometry=point, Motion=unit_z)  # -> Geometry, Transform
pointsat = Hops(
    Curve=reparameterize(curve),
    T=range,
    CacheResultsInMemory=True,
    CacheSolveResults=True,
    RemoteDefinitionLocation="http://127.0.0.1:5000/pointsat",
    RemoteSolveVersion=(0, 1, 0),
    ShowInput_Enabled=False,
    ShowInput_Path=False,
    SynchronousSolve=True)
panel = Panel(pointsat)
dispatch = Dispatch(List=flatten(move.Geometry), DispatchPattern=[True, False])  # -> ListA, ListB
line = Line(StartPoint=dispatch.ListB, EndPoint=dispatch.ListA)
pointat = Hops(
    Curve=reparameterize(line),
    T=number_slider_2,
    CacheResultsInMemory=True,
    CacheSolveResults=True,
    RemoteDefinitionLocation="http://127.0.0.1:5000/pointat",
    RemoteSolveVersion=(0, 1, 0),
    ShowInput_Enabled=False,
    ShowInput_Path=False,
    SynchronousSolve=True)
pointat_2 = Hops(
    Curve=reparameterize(curve),
    T=number_slider_2,
    CacheResultsInMemory=False,
    CacheSolveResults=False,
    RemoteDefinitionLocation="http://127.0.0.1:5000/pointat",
    RemoteSolveVersion=(0, 1, 0),
    ShowInput_Enabled=False,
    ShowInput_Path=False,
    SynchronousSolve=True)
curve_end_points_2 = Hops(
    Curve=reparameterize(line),
    CacheResultsInMemory=False,
    CacheSolveResults=False,
    RemoteDefinitionLocation="http://127.0.0.1:5000/curve_end_points",
    RemoteSolveVersion=(0, 1, 0),
    ShowInput_Enabled=False,
    ShowInput_Path=False,
    SynchronousSolve=True)  # -> S, E
srf4pt = Hops(
    CornerA=curve_end_points.S,
    CornerB=pointat_2,
    CornerC=curve_end_points_2.S,
    CornerD=pointat,
    CacheResultsInMemory=False,
    CacheSolveResults=False,
    RemoteDefinitionLocation="http://127.0.0.1:5000/srf4pt",
    RemoteSolveVersion=(0, 1, 0),
    ShowInput_Enabled=False,
    ShowInput_Path=False,
    SynchronousSolve=True)
panel_2 = Panel()
strings = Hops(
    A=panel_2,
    B="Michael Wickerson",
    CacheResultsInMemory=False,
    CacheSolveResults=False,
    RemoteDefinitionLocation="http://127.0.0.1:5000/strings",
    RemoteSolveVersion=(0, 1, 0),
    ShowInput_Enabled=False,
    ShowInput_Path=False,
    SynchronousSolve=True)  # -> A, Concat, Length, Upper, Lower, Split, Join, Replace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
panel_3 = Panel([strings.A, strings.Concat, strings.Length, strings.Upper, strings.Lower, strings.Split, strings.Join, strings.Replace, strings.Strip, strings.Startswith, strings.Endswith, strings.Find, strings.Count, strings.Index])
