# Grasshopper definition PFHG_006.gh (Grasshopper 1.0.7)
# plug-ins: Hops

# ----
# FLASK | HOPS | PYTHON 3 | GRASSHOPPER
# PFHG_006.gh
# Examples Wickerson Studios
# FIRST CLASS
# FUNCTIONS:
# 
# assign functions to variables
# /cubeIt
# 
# pass functions as arguments
# to other functions
# /_funcAsArg
# 
# return functions from
# other functions
# /retrunFunc5
number_slider = Slider(2, range=0..10)
retrunfunc5 = Hops(
    Num=Slider(3, range=0..10),
    CacheResultsInMemory=True,
    CacheSolveResults=True,
    RemoteDefinitionLocation="http://127.0.0.1:5000/returnFunc5",
    RemoteSolveVersion=(0, 1, 0),
    ShowInput_Enabled=False,
    ShowInput_Path=False,
    SynchronousSolve=True)
cubeit = Hops(
    Num=number_slider,
    CacheResultsInMemory=True,
    CacheSolveResults=True,
    RemoteDefinitionLocation="http://127.0.0.1:5000/cubeIt",
    RemoteSolveVersion=(0, 1, 0),
    ShowInput_Enabled=False,
    ShowInput_Path=False,
    SynchronousSolve=True)
funcasarg = Hops(
    Num=Slider(2, range=0..10),
    CacheResultsInMemory=False,
    CacheSolveResults=False,
    RemoteDefinitionLocation="http://127.0.0.1:5000/_funcAsArg",
    RemoteSolveVersion=(0, 1, 0),
    ShowInput_Enabled=False,
    ShowInput_Path=False,
    SynchronousSolve=True)
# DECORATORS
# 
# @gfg_decorator
# def hello_decorator():
#     print("Gfg")
# 
# '''Above code is equivalent to -
# 
# def hello_decorator():
#     print("Gfg")
# 
# hello_decorator = gfg_decorator(hello_decorator)'''
# CLOSURES VS. CLASSES
# nested functions:
# 
# def outerFunction(text):
#     text = text
# 
#     def innerFunction():
#         print(text)
# 
#     innerFunction()
# 
# if __name__ == '__main__':
#     outerFunction('Hey!')
panel = Panel(cubeit)
panel_2 = Panel(retrunfunc5)
panel_3 = Panel(funcasarg)
