# Grasshopper definition PFHG_013.gh (Grasshopper 1.0.7)
# plug-ins: Hops

range = Range(Domain=Domain(0, 1), Steps=10)
jitter = Jitter(List=range, Jitter=1, Seed=2)  # -> Values, Indices
# FLASK | HOPS | PYTHON 3 | GRASSHOPPER
# PFHG_013.gh
# Examples Wickerson Studios
# ALGORITHMS
# /bubble
panel = Panel(jitter.Values)
bubble = Hops(
    NumberList=panel,
    CacheResultsInMemory=True,
    CacheSolveResults=True,
    RemoteDefinitionLocation="http://127.0.0.1:5000/bubble",
    RemoteSolveVersion=(0, 1, 0),
    ShowInput_Enabled=False,
    ShowInput_Path=False,
    SynchronousSolve=True)
panel_2 = Panel(bubble)
