# Grasshopper definition PFHG_018.gh (Grasshopper 1.0.7)
# plug-ins: LunchBox, Hops

panel = Panel("C:\Users\Sculpture\Desktop\PythonFlaskGrasshopper\compute.rhino3d-master\src\ghhops-server-py\examples\Colors.txt")
# Generating variations on image data:
panel_2 = Panel("Colorblk.jpg")
# Sampling data in different ways:
panel_3 = Panel("Colors.txt")

# ----
# FLASK | HOPS | PYTHON 3 | GRASSHOPPER
# PFHG_018.gh
# DATA SCIENCE
# 4 DUMMIES
# working with real data:
# LUNCHBOX PLUG-IN
read_csv = ReadCSV(Delimiter=",")  # -> Headers, Values
create_csv = CreateCSV(Delimiter=",")

file_path = FilePath("Colors.txt")
file_path_2 = FilePath("Colors.txt")
file_path_3 = FilePath(panel_2)
file_path_4 = FilePath("Colorblk.jpg")
file_path_5 = FilePath("Colors.txt")
file_path_6 = FilePath(panel_3)
file_path_7 = FilePath(panel)
file_path_8 = FilePath("Colors.txt")
file_path_9 = FilePath("Colors.txt")
open_txt_int = Hops(
    FilePath=file_path_8,
    Count=Slider(72, range=0..100),
    CacheResultsInMemory=True,
    CacheSolveResults=True,
    RemoteDefinitionLocation="http://127.0.0.1:5000/open_txt_int",
    RemoteSolveVersion=(0, 1, 0),
    ShowInput_Enabled=False,
    ShowInput_Path=False,
    SynchronousSolve=True)
open_txt_stream4 = Hops(
    FilePath=file_path_2,
    CacheResultsInMemory=True,
    CacheSolveResults=True,
    RemoteDefinitionLocation="http://127.0.0.1:5000/open_txt_stream4",
    RemoteSolveVersion=(0, 1, 0),
    ShowInput_Enabled=False,
    ShowInput_Path=False,
    SynchronousSolve=True)
read_file = ReadFile(File=file_path_7, PerLineParse=True)
open_txt = Hops(
    FilePath=file_path_9,
    CacheResultsInMemory=True,
    CacheSolveResults=True,
    RemoteDefinitionLocation="http://127.0.0.1:5000/open_txt",
    RemoteSolveVersion=(0, 1, 0),
    ShowInput_Enabled=False,
    ShowInput_Path=False,
    SynchronousSolve=True)
open_image3 = Hops(
    FilePath=file_path_3,
    CacheResultsInMemory=True,
    CacheSolveResults=True,
    RemoteDefinitionLocation="http://127.0.0.1:5000/open_image3",
    RemoteSolveVersion=(0, 1, 0),
    ShowInput_Enabled=False,
    ShowInput_Path=False,
    SynchronousSolve=True)
open_image5 = Hops(
    FilePath=file_path_4,
    CacheResultsInMemory=True,
    CacheSolveResults=True,
    RemoteDefinitionLocation="http://127.0.0.1:5000/open_image5",
    RemoteSolveVersion=(0, 1, 0),
    ShowInput_Enabled=False,
    ShowInput_Path=False,
    SynchronousSolve=True)  # -> Shape, Size
open_txt_mod = Hops(
    FilePath=file_path_5,
    Mod=Slider(3, range=1..4),
    CacheResultsInMemory=True,
    CacheSolveResults=True,
    RemoteDefinitionLocation="http://127.0.0.1:5000/open_txt_mod",
    RemoteSolveVersion=(0, 1, 0),
    ShowInput_Enabled=False,
    ShowInput_Path=False,
    SynchronousSolve=True)
open_txt_sample5 = Hops(
    FilePath=file_path_6,
    CacheResultsInMemory=True,
    CacheSolveResults=True,
    RemoteDefinitionLocation="http://127.0.0.1:5000/open_txt_sample5",
    RemoteSolveVersion=(0, 1, 0),
    ShowInput_Enabled=False,
    ShowInput_Path=False,
    SynchronousSolve=True)
open_txt_random2 = Hops(
    FilePath=file_path,
    Prob=Slider(0.3, range=0..1),
    CacheResultsInMemory=True,
    CacheSolveResults=True,
    RemoteDefinitionLocation="http://127.0.0.1:5000/open_txt_random2",
    RemoteSolveVersion=(0, 1, 0),
    ShowInput_Enabled=False,
    ShowInput_Path=False,
    SynchronousSolve=True)
panel_4 = Panel(open_txt)
panel_5 = Panel(open_txt_int)
panel_6 = Panel(open_txt_stream4)
panel_7 = Panel(open_txt_random2)
panel_8 = Panel(open_txt_mod)
panel_9 = Panel(open_txt_sample5)
read_csv_2 = ReadCSV(CSVString=read_file, Delimiter=",")  # -> Headers, Values
panel_10 = Panel(open_image5.Shape)
panel_11 = Panel(open_image5.Size)
panel_12 = Panel(read_csv_2.Headers)
panel_13 = Panel(read_csv_2.Values)
